# Dynamo graph Cut-Fill Model Creation.dyn (Dynamo 1.3.4.6666)

# group: Inputs
desired_volume = DoubleInput(415.2)
length_width_ratio = DoubleSlider(1.5, range=1..4 step 0.25)

# group: Process
XY = Plane.XY()
python_script = Python(IN[0]=desired_volume, IN[1]=length_width_ratio)
# ---------- python_script.python (26 lines) ----------
import clr
clr.AddReference('ProtoGeometry')
from Autodesk.DesignScript.Geometry import *
#The inputs to this node will be stored as a list in the IN variables.
dataEnteringNode = IN

length = 1
volume = IN[0]
ratio = IN[1]

while True:
	width = length/ratio
	height = min(length,width)/4
	a = length
	b = width
	c = (length - height)/2
	d = (width - height)/2
	h = height
	new_volume = ((a*b+(a+c)*(b+d)+c*d)*(h))/6
	if new_volume >= volume:
		break
	else:
		length += .0001
	

OUT = [new_volume, length, width]
# ----------------------------------------
python_script_2 = Python(IN[0]=python_script)
# ---------- python_script_2.python (13 lines) ----------
import clr
clr.AddReference('ProtoGeometry')
from Autodesk.DesignScript.Geometry import *
#The inputs to this node will be stored as a list in the IN variables.
dataEnteringNode = IN


width = IN[0][2]



#Assign your output to the OUT variable.
OUT = IN[0][2]
# ----------------------------------------
python_script_3 = Python(IN[0]=python_script)
# ---------- python_script_3.python (8 lines) ----------
import clr
clr.AddReference('ProtoGeometry')
from Autodesk.DesignScript.Geometry import *
#The inputs to this node will be stored as a list in the IN variables.
dataEnteringNode = IN

#Assign your output to the OUT variable.
OUT = IN[0][1]
# ----------------------------------------
python_script_4 = Python(IN[0]=python_script_2, IN[1]=python_script_3)
# ---------- python_script_4.python (11 lines) ----------
import clr
clr.AddReference('ProtoGeometry')
from Autodesk.DesignScript.Geometry import *
#The inputs to this node will be stored as a list in the IN variables.
dataEnteringNode = IN

min = min(IN)


#Assign your output to the OUT variable.
OUT = min/4
# ----------------------------------------
offset = Plane.Offset(XY, python_script_4)
python_script_5 = Python(IN[0]=python_script_4, IN[1]=python_script_2)
# ---------- python_script_5.python (9 lines) ----------
import clr
clr.AddReference('ProtoGeometry')
from Autodesk.DesignScript.Geometry import *
#The inputs to this node will be stored as a list in the IN variables.
dataEnteringNode = IN


#Assign your output to the OUT variable.
OUT = (IN[1] - IN[0])/2
# ----------------------------------------
python_script_6 = Python(IN[0]=python_script_4, IN[1]=python_script_3)
# ---------- python_script_6.python (8 lines) ----------
import clr
clr.AddReference('ProtoGeometry')
from Autodesk.DesignScript.Geometry import *
#The inputs to this node will be stored as a list in the IN variables.
dataEnteringNode = IN

#Assign your output to the OUT variable.
OUT = (IN[1] - IN[0])/2
# ----------------------------------------
byWidthLength = Rectangle.ByWidthLength(plane=offset, width=python_script_5, length=python_script_6)
byPatch = Surface.ByPatch(byWidthLength)
byWidthLength_2 = Rectangle.ByWidthLength(width=python_script_2, length=python_script_3)
create = List.Create(byWidthLength, byWidthLength_2)
byLoft = Solid.ByLoft(create)
volume = Solid.Volume(byLoft)
byPatch_2 = Surface.ByPatch(byWidthLength_2)
area = Surface.Area(byPatch_2)

# group: Output/Volume of shape created List: 0: Volume 1: Length 2: Width
volume_of_model = Watch(volume)
print = Watch(python_script)
area_of_base = Watch(area)
