# Dynamo graph Footings_Revit2019.dyn (Dynamo 1.3.4.6666)

# group: Input
number_slider = DoubleSlider(-83, range=-100..0 step 1)

# group: Body
categories = Categories("StructuralFoundation")
all_elements_of_category = ElementsOfCategory(categories)
type = Object.Type(all_elements_of_category)
python_script = Python(IN[0]=type, IN[1]=all_elements_of_category)
# ---------- python_script.python (21 lines) ----------
# Load the Python Standard and DesignScript Libraries
import sys
import clr
clr.AddReference('ProtoGeometry')
from Autodesk.DesignScript.Geometry import *

# The inputs to this node will be stored as a list in the IN variables.
dataEnteringNode = IN

# Place your code below this line
footings = []

for x in range(0,len(IN[0])):
	if IN[0][x] == 'Revit.Elements.FamilyInstance':
		footings.append(IN[1][x])




# Assign your output to the OUT variable.
OUT = footings
# ----------------------------------------
geometry = Element.Geometry(python_script)
faces = Topology.Faces(geometry)
python_script_2 = Python(IN[0]=faces)
# ---------- python_script_2.python (18 lines) ----------
# Load the Python Standard and DesignScript Libraries
import sys
import clr
clr.AddReference('ProtoGeometry')
from Autodesk.DesignScript.Geometry import *

# The inputs to this node will be stored as a list in the IN variables.
dataEnteringNode = IN

faces = []
for x in range(0,len(IN[0])):
	if len(IN[0][x][0]) == 6:
		faces.append(IN[0][x][0][1])


# Place your code below this line
# Assign your output to the OUT variable.
OUT = faces
# ----------------------------------------
vertices = Face.Vertices(python_script_2)
pointGeometry = Vertex.PointGeometry(vertices)
byCornerPoints = Rectangle.ByCornerPoints(pointGeometry)
python_script_3 = Python(IN[0]=faces, IN[1]=geometry)
# ---------- python_script_3.python (17 lines) ----------
# Load the Python Standard and DesignScript Libraries
import sys
import clr
clr.AddReference('ProtoGeometry')
from Autodesk.DesignScript.Geometry import *

# The inputs to this node will be stored as a list in the IN variables.
dataEnteringNode = IN

# Place your code below this line
solids = []
for x in range(0,len(IN[0])):
	if len(IN[0][x][0]) == 6:
		solids.append(IN[1][x][0])

# Assign your output to the OUT variable.
OUT = solids
# ----------------------------------------
centroid = Solid.Centroid(python_script_3)
X = Point.X(centroid)
Y = Point.Y(centroid)
Z = Point.Z(pointGeometry)
python_script_4 = Python(IN[0]=Z)
# ---------- python_script_4.python (18 lines) ----------
# Load the Python Standard and DesignScript Libraries
import sys
import clr
clr.AddReference('ProtoGeometry')
from Autodesk.DesignScript.Geometry import *

# The inputs to this node will be stored as a list in the IN variables.
dataEnteringNode = IN



bottom = []

# Place your code below this line
for x in range(0,len(IN[0])):
	bottom.append(min(IN[0][x]))
# Assign your output to the OUT variable.
OUT = bottom
# ----------------------------------------
byCoordinates = Point.ByCoordinates(x=X, y=Y, z=python_script_4)
byOriginNormal = Plane.ByOriginNormal(origin=byCoordinates)
offset = Plane.Offset(byOriginNormal, number_slider)
width = Rectangle.Width(byCornerPoints)
python_script_5 = Python(IN[0]=number_slider, IN[1]=width)
# ---------- python_script_5.python (19 lines) ----------
# Load the Python Standard and DesignScript Libraries
import sys
import clr
clr.AddReference('ProtoGeometry')
from Autodesk.DesignScript.Geometry import *

# The inputs to this node will be stored as a list in the IN variables.
dataEnteringNode = IN

widths = []


# Place your code below this line

for x in range(0,len(IN[1])):
	widths.append(2*abs(IN[0]) + IN[1][x])

# Assign your output to the OUT variable.
OUT = widths
# ----------------------------------------
height = Rectangle.Height(byCornerPoints)
python_script_6 = Python(IN[0]=number_slider, IN[1]=height)
# ---------- python_script_6.python (16 lines) ----------
# Load the Python Standard and DesignScript Libraries
import sys
import clr
clr.AddReference('ProtoGeometry')
from Autodesk.DesignScript.Geometry import *

# The inputs to this node will be stored as a list in the IN variables.
dataEnteringNode = IN

lengths = []
# Place your code below this line
for x in range(0,len(IN[1])):
	lengths.append(2*abs(IN[0]) + IN[1][x])
	
# Assign your output to the OUT variable.
OUT = lengths
# ----------------------------------------
byWidthLength = Rectangle.ByWidthLength(plane=offset, width=python_script_5, length=python_script_6)
number = DoubleInput(1)
byCoordinates_2 = Vector.ByCoordinates(x=number)
X_2 = Point.X(pointGeometry)
python_script_7 = Python(IN[0]=X_2)
# ---------- python_script_7.python (18 lines) ----------
# Load the Python Standard and DesignScript Libraries
import sys
import clr
clr.AddReference('ProtoGeometry')
from Autodesk.DesignScript.Geometry import *

# The inputs to this node will be stored as a list in the IN variables.
dataEnteringNode = IN

# Place your code below this line


x_vector = []

for x in range(0,len(IN[0])):
	x_vector.append(IN[0][x][0] - IN[0][x][1])
# Assign your output to the OUT variable.
OUT = x_vector
# ----------------------------------------
Y_2 = Point.Y(pointGeometry)
python_script_8 = Python(IN[0]=Y_2)
# ---------- python_script_8.python (15 lines) ----------
# Load the Python Standard and DesignScript Libraries
import sys
import clr
clr.AddReference('ProtoGeometry')
from Autodesk.DesignScript.Geometry import *

# The inputs to this node will be stored as a list in the IN variables.
dataEnteringNode = IN

y_vector = []

for x in range(0,len(IN[0])):
	y_vector.append(IN[0][x][0] - IN[0][x][1])
# Assign your output to the OUT variable.
OUT = y_vector
# ----------------------------------------
byCoordinates_3 = Vector.ByCoordinates(x=python_script_7, y=python_script_8)
angleWithVector = Vector.AngleWithVector(vector=byCoordinates_2, otherVector=byCoordinates_3)
number_2 = DoubleInput(90)
mod = angleWithVector % number_2
rotate = Geometry.Rotate(byWidthLength, offset, mod)
create = List.Create(byCornerPoints, rotate)
python_script_9 = Python(IN[0]=create)
# ---------- python_script_9.python (18 lines) ----------
# Load the Python Standard and DesignScript Libraries
import sys
import clr
clr.AddReference('ProtoGeometry')
from Autodesk.DesignScript.Geometry import *

# The inputs to this node will be stored as a list in the IN variables.
dataEnteringNode = IN

# Place your code below this line
curves = []

for x in range(0,len(IN[0][0])):
	temp_curve = IN[0][0][x], IN[0][1][x]
	curves.append(temp_curve)

# Assign your output to the OUT variable.
OUT = curves
# ----------------------------------------
byLoft = Solid.ByLoft(python_script_9)
categories_2 = Categories("StructuralStiffener")
byGeometry = DirectShape.ByGeometry(geometry=byLoft, category=categories_2)
byPatch = Surface.ByPatch(byCornerPoints)
